test file "FSM_test"

suite "DEAD"
  description: This suite contains all the test performed with DEAD as main state. It includes also the transitions from dead to other states.

  case "Dead-Dead" [baseline]
    description: DEAD state check:
      -no SOC
      -no fuel
      -Uniformely increasing acceleration request
      -zero brake request
      The state should be DEAD for all the testing time.
    model FSM_Model
    input "Dead1.mat", mapped to realSpeed, Fuel, SOC, AccPedal, BrakePedal (active)
    baseline "Dead1.mat"
      state:1

  case "Dead-Regen" [baseline]
    description: DEAD to Regen state transition check:
      -fuel < fuelMin
      -SOC< SOCMin
      -BrakePedal request at 5s
    model FSM_Model
    input "Dead2.mat", mapped to realSpeed, Fuel, SOC, AccPedal, BrakePedal (active)
    baseline "Dead2_baseline.mat"
      state:1

  case "Dead-ED" [baseline]
    description: DEAD to ED state transition check:
      -SOC > SOCMin
      -AccPedal < maxAccMGU
      The state should pass from DEAD to Electric Drive
    model FSM_Model
    input "Dead3.mat", mapped to realSpeed, Fuel, SOC, AccPedal, BrakePedal (active)
    baseline "Dead3_baseline.mat"
      state:1

  case "StrangeCase" [baseline]
    description: No transition due to T>Ted && fuel < fuelMin.
      Possible solution: remove T<Ted in transition from Dead to ED
    model FSM_Model
    input "StrangeCase.mat", mapped to realSpeed, Fuel, SOC, AccPedal, BrakePedal (active)

  case "Dead-NoCharge" [baseline]
    description: DEAD to No Charge state transition check:
      -SOC < SOCMin
      -fuel > fuelMin
      -AccPedal < maxAccICE
      The state should pass from DEAD to No Charge
    model FSM_Model
    input "Dead4.mat", mapped to realSpeed, Fuel, SOC, AccPedal, BrakePedal (active)
    baseline "Dead4_baseline.mat"
      state:1

  case "Dead-Combined" [baseline]
    description: DEAD to Combined state transition check:
      -SOC > SOCMin
      -fuel > fuelMin
      -AccPedal>maxAccMGU
      The state should pass from DEAD to Combined
    model FSM_Model
    input "Dead5.mat", mapped to realSpeed, Fuel, SOC, AccPedal, BrakePedal (active)
    baseline "Dead5_baseline.mat"
      state:1

suite "No Charge"
  description: From No Charge to all other states. Initially, the FSM starts from DEAD, but soon enters the No Charge state at the first sampling instant.

  case "NoCharge-DEAD" [baseline]
    description: Transition from No Charge to DEAD:
      Fuel < fuelMin
      SOC < SOCmin
    model FSM_Model
    input "NoCharge1.mat", mapped to realSpeed, Fuel, SOC, AccPedal, BrakePedal (active)
    baseline "NoChargeToDEAD_baseline.mat"
      state:1

  case "NoCharge-Regen" [baseline]
    description: Transition from No Charge to Regenerative Braking:
      Fuel > fuelMin
      SOC < SOCmin
      BrakePedal request after 5s
    model FSM_Model
    input "NoCharge2.mat", mapped to realSpeed, Fuel, SOC, AccPedal, BrakePedal (active)
    baseline "NoChargeToRegen_baseline.mat"
      state:1

  case "NoCharge-ED" [baseline]
    description: Transition from No Charge to Regenerative Braking:
      Fuel > fuelMin
      SOC < SOCmin for a while, then SOC>SOCmin
      RealSpeed<SpeedEDMax or Fuel<fuelMin after a while
      This check is done in two iterations
    model FSM_Model
    input "NoCharge3.mat", mapped to realSpeed, Fuel, SOC, AccPedal, BrakePedal (active)
    input "NoCharge4.mat", mapped to realSpeed, Fuel, SOC, AccPedal, BrakePedal
    baseline "NoCharge_ED_baseline_Iteration1.mat"
      state:1
    baseline "NoCharge_ED_baseline_Iteration2.mat"
      state:1
    iterations:
      Iteration1: ExternalInput "NoCharge3.mat", Baseline "NoCharge_ED_baseline_Iteration1.mat"
      Iteration2: ExternalInput "NoCharge4.mat", Baseline "NoCharge_ED_baseline_Iteration2.mat"

  case "NoCharge-Combined" [baseline]
    description: Transition from No Charge to Combined:
      Fuel > fuelMin
      SOC > SOCmin
      AccPedal> MaxAccICE
    model FSM_Model
    input "NoCharge5.mat", mapped to realSpeed, Fuel, SOC, AccPedal, BrakePedal (active)
    baseline "NoChargeToCombined_baseline.mat"
      state:1

  case "NoCharge-NoCharge" [baseline]
    description: No Charge state check:
      -no SOC
      -Fuel>fuelMin
      -Uniformely increasing acceleration request
      The state should be No Charge for all the testing time.
    model FSM_Model
    input "NoCharge6.mat", mapped to realSpeed, Fuel, SOC, AccPedal, BrakePedal (active)
    baseline "NoCharge_NoCharge_baseline.mat"
      state:1

suite "ED"
  description: From Electrical Drive to all other states. Initially, the FSM starts from DEAD, but soon enters the ED state at the first sampling instant.

  case "ED-ED" [baseline]
    description: ED state check:
      -SOC>SOCMin
      -Fuel>fuelMin
      -RealSpeed<SpeedEDMax
      -AccPedal<MaxAccMGU
      The state should be ED for all the testing time.
    model FSM_Model
    input "ED1.mat", mapped to realSpeed, Fuel, SOC, AccPedal, BrakePedal (active)
    baseline "ED_ED_baseline.mat"
      state:1

  case "ED-Regen" [baseline]
    description: Transition from Electrical Drive to Regenerative Braking:
      SOC > SOCmin
      RealSpeed < SpeedMaxED
      BrakePedal request after 5s
    model FSM_Model
    input "ED2.mat", mapped to realSpeed, Fuel, SOC, AccPedal, BrakePedal (active)
    baseline "ED_Regen_baseline.mat"
      state:1

  case "ED-DEAD" [baseline]
    description: Transition from Electrical Drive to DEAD:
      Fuel < fuelMin
      SOC < SOCmin
    model FSM_Model
    input "ED3.mat", mapped to realSpeed, Fuel, SOC, AccPedal, BrakePedal (active)
    baseline "ED_Dead_baseline.mat"
      state:1

  case "ED-NoCharge" [baseline]
    description: ED to No Charge state transition check:
      -SOC < SOCMin
      -fuel > fuelMin
      -AccPedal < maxAccICE
      The state should pass from ED to No Charge
    model FSM_Model
    input "ED4.mat", mapped to realSpeed, Fuel, SOC, AccPedal, BrakePedal (active)
    baseline "ED_NoCharge_baseline.mat"
      state:1

  case "ED-Combined" [baseline]
    description: Transition from Electrical Drive to Combined:
      Fuel > fuelMin
      SOC > SOCmin
      AccPedal> MaxAccMGU
      or
      RealSpeed>MaxSpeedMGU
    model FSM_Model
    input "ED5.mat", mapped to realSpeed, Fuel, SOC, AccPedal, BrakePedal
    input "ED6.mat", mapped to realSpeed, Fuel, SOC, AccPedal, BrakePedal (active)
    baseline "ED_Comb_baseline1.mat"
      state:1
    baseline "ED_Comb_baseline2.mat"
      state:1
    iterations:
      Iteration1: ExternalInput "ED5.mat", Baseline "ED_Comb_baseline1.mat"
      Iteration2: ExternalInput "ED6.mat", Baseline "ED_Comb_baseline2.mat"

suite "Combined"
  description: From Combined to all other states. Initially, the FSM starts from DEAD, but soon enters the Combined state at the first sampling instant.

  case "Combined-Combined" [baseline]
    description: Combined state check:
      -SOC>SOCMin
      -Fuel>fuelMin
      -RealSpeed>SpeedEDMax
      The state should be Combined for all the testing time.
    model FSM_Model
    input "Comb1.mat", mapped to realSpeed, Fuel, SOC, AccPedal, BrakePedal (active)
    baseline "Comb_Comb_baseline.mat"
      state:1

  case "Combined-Regen" [baseline]
    description: Transition from Combined to Regenerative Braking:
      SOC > SOCmin
      fuel>fuelMin
      RealSpeed > SpeedMaxED
      BrakePedal request after 5s
    model FSM_Model
    input "Comb2.mat", mapped to realSpeed, Fuel, SOC, AccPedal, BrakePedal (active)
    baseline "Comb_Regen_baseline.mat"
      state:1

  case "Combined-DEAD" [baseline]
    description: Transition from Combined to DEAD:
      Fuel < fuelMin
      SOC < SOCmin
    model FSM_Model
    input "Comb3.mat", mapped to realSpeed, Fuel, SOC, AccPedal, BrakePedal (active)
    baseline "Comb_Dead_baseline.mat"
      state:1

  case "Combined-ED" [baseline]
    description: Combined to ED transition check:
      -SOC>SOCMin
      -RealSpeed < SpeedEDMax after 5s
      -AccPedal < MaxAccMGU after 5s
    model FSM_Model
    input "Comb4.mat", mapped to realSpeed, Fuel, SOC, AccPedal, BrakePedal (active)
    baseline "Comb_ED_baseline.mat"
      state:1

  case "Combined-NoCharge" [baseline]
    description: Combined to No Charge state transition check:
      -SOC < SOCMin
      -fuel > fuelMin
      -AccPedal < maxAccICE
      The state should pass from Combined to No Charge
    model FSM_Model
    input "Comb5.mat", mapped to realSpeed, Fuel, SOC, AccPedal, BrakePedal (active)
    baseline "Comb_NoCharge_baseline.mat"
      state:1

suite "Regen"
  description: From Regenerative Braking to all other states. Initially, the FSM starts from DEAD, but soon enters the Regen state at the first sampling instant.

  case "Regen-Regen" [baseline]
    description: Regenerative Braking state check:
      -BrakePedal > 0
      The state should be Regenerative Braking for all the testing time.
    model FSM_Model
    input "Regen1.mat", mapped to realSpeed, Fuel, SOC, AccPedal, BrakePedal (active)
    baseline "Regen_Regen_baseline.mat"
      state:1

  case "Regen-DEAD" [baseline]
    description: Transition from Regenerative Braking to DEAD:
      Fuel < fuelMin
      SOC < SOCmin
      AccPedal > 0
    model FSM_Model
    input "Regen2.mat", mapped to realSpeed, Fuel, SOC, AccPedal, BrakePedal (active)
    baseline "Regen_Dead_baseline.mat"
      state:1

  case "Regen-ED" [baseline]
    description: Transition from Regenerative Braking to ED
      SOC < SOCmin for a while, then SOC>SOCmin
      RealSpeed<SpeedEDMax
    model FSM_Model
    input "Regen3.mat", mapped to realSpeed, Fuel, SOC, AccPedal, BrakePedal (active)
    baseline "Regen_ED_baseline.mat"
      state:1

  case "Regen-NoCharge" [baseline]
    description: Transition check from Regenerative Braking to No Charge state:
      -BrakePedal > 0 until 5s
      -AccPedal > 0 after 5s
      -fuel>fuelMin
      -SOC<SOCMin
    model FSM_Model
    input "Regen4.mat", mapped to realSpeed, Fuel, SOC, AccPedal, BrakePedal (active)

  case "Regen-Combined" [baseline]
    description: Transition from Regen to Combined state:
      -SOC > SOCMin
      -Fuel> fuelMin
      -RealSpeed > SpeedMaxMGU
      -BrakePedal = 0 after 5s
      -AccPedal > 0 after 5s
    model FSM_Model
    input "Regen5.mat", mapped to realSpeed, Fuel, SOC, AccPedal, BrakePedal (active)
    baseline "Regen_Combined_baseline.mat"
      state:1