test file "IntegrationTest"

suite "IntegrationTest Suite 1"

  case "Test Case 1" [simulation]
    description: Scenario 1: Vehicle in full electrical drive
      INPUTS conditions:
      - request AccPedal < MaxAccMGU (t = 5s)
      - Low speed condtions
      - BrakePedal: 0
      - SOC > SOCMin
      - Fuel > fuelMin
      EXPECTED OUTPUT:
      Only MGU mode: due to low speed, controller must demand torque only to the MGU (MGUdem != 0).
    model ControllerModel
    input "Scenario1.mat", mapped to AccPedal, BrakePedal, fuelLevel, SOC, realSpeed (active)
    assessment "Assessment1": At any point of time, if AccPedal > 0 becomes true then, with a delay of at most 0.4, MGUdem > 0 & ICEdem ==0 & Brake == 0 must be true
      AccPedal: signal ControllerModel/AccPedal, port 1
      MGUdem: signal ControllerModel/Controller, port 3
      ICEdem: signal ControllerModel/Controller, port 1
      Brake: signal ControllerModel/Controller, port 2

  case "Test Case 2" [simulation]
    description: Scenario 2: No charge
      INPUTS conditions:
      - request AccPedal < MaxAccMGU (t = 5s)
      - Low speed condtions
      - BrakePedal: 0
      - SOC < SOCMin
      - Fuel > fuelMin
      EXPECTED OUTPUT:
      Only ICE mode: due to battery low level, controller must demand torque only to the ICE (ICEdem != 0)discarding the MGU.
    model ControllerModel
    input "Scenario2.mat", mapped to AccPedal, BrakePedal, fuelLevel, SOC, realSpeed (active)
    assessment "Assessment1": At any point of time, if AccPedal > 0 becomes true then, with a delay of at most 0.4, ICEdem > 0 & Brake == 0 & MGUdem == 0 must be true
      AccPedal: signal ControllerModel/AccPedal, port 1
      ICEdem: signal ControllerModel/Controller, port 1
      Brake: signal ControllerModel/Controller, port 2
      MGUdem: signal ControllerModel/Controller, port 3

  case "Test Case 3" [simulation]
    description: Scenario 3: No fuel conditions
      INPUTS conditions:
      - request AccPedal > MaxAccMGU (t = 5s)
      - Low speed condtions
      - BrakePedal: 0
      - SOC > SOCMin
      - Fuel < fuelMin
      EXPECTED OUTPUT:
      Only MGU mode and saturation at max value of MGU request: due to low speed and low fuel level, a saturation of the MGU request in terms of torque is expected because of the higher 𝐴𝑐𝑐𝑃𝑒𝑑𝑎𝑙 request after 5s.
    model ControllerModel
    input "Scenario3.mat", mapped to AccPedal, BrakePedal, fuelLevel, SOC, realSpeed (active)
    assessment "Assessment1": At any point of time, if AccPedal > 0 becomes true then, with a delay of at most 0.4, ICEdem == 0 & MGUdem == 1 & Brake == 0 must be true
      AccPedal: signal ControllerModel/AccPedal, port 1
      ICEdem: signal ControllerModel/Controller, port 1
      MGUdem: signal ControllerModel/Controller, port 3
      Brake: signal ControllerModel/Controller, port 2

  case "Test Case 4" [simulation]
    description: Scenario 4: No charge conditions
      INPUTS conditions:
      - request AccPedal > MaxAccICE (t = 5s)
      - Low speed condtions
      - BrakePedal: 0
      - SOC < SOCMin
      - Fuel > fuelMin
      EXPECTED OUTPUT:
      Only ICE mode and saturation at max value of ICE request: expected saturation of the ICE torque request because of the higher AccPedal (higher with respect to the maximum ICE acceleration) request after 5s. No MGU request expected due to low SOC level.
    model ControllerModel
    input "Scenario4.mat", mapped to AccPedal, BrakePedal, fuelLevel, SOC, realSpeed (active)
    assessment "Assessment1": At any point of time, if AccPedal > 0 becomes true then, with a delay of at most 0.4, ICEdem == 1 & MGUdem == 0 & Brake == 0 must be true
      AccPedal: signal ControllerModel/AccPedal, port 1
      ICEdem: signal ControllerModel/Controller, port 1
      MGUdem: signal ControllerModel/Controller, port 3
      Brake: signal ControllerModel/Controller, port 2

  case "Test Case 5" [simulation]
    description: Scenario 5: Combined and Regen. braking transition
      INPUTS conditions:
      - request AccPedal > MaxAccMGU (t = 5s)
      - High speed condtions
      - BrakePedal: != 0 at t = 5s
      - SOC > SOCMin
      - Fuel > fuelMin
      EXPECTED OUTPUT:
      Both MGU and ICE requests, Regen. braking when braking: in this case car is traveling at high speed, so that the controller cannot work in Electrical Drive only. Both fuel and SOC are above the minimum for working. When braking, Regen. braking state is expected.
    model ControllerModel
    input "Scenario5.mat", mapped to AccPedal, BrakePedal, fuelLevel, SOC, realSpeed (active)
    assessment "Assessment1": At any point of time, whenever AccPedal > 0 is true then, with a delay of at most 0.2, ICEdem > 0 & MGUdem > 0 & Brake == 0 must be true
    assessment "Assessment2": At any point of time, whenever BrakePedal > 0 is true then, with a delay of at most 0.4, MGUdem < 0 & ICEdem == 0 & Brake > 0 must be true
      AccPedal: signal ControllerModel/AccPedal, port 1
      ICEdem: signal ControllerModel/Controller, port 1
      MGUdem: signal ControllerModel/Controller, port 3
      Brake: signal ControllerModel/Controller, port 2
      BrakePedal: signal ControllerModel/BrakePedal, port 1

  case "Test Case 6" [simulation]
    description: Scenario 6: Dead conditions (no fuel, no charge) and Regen. braking
      INPUTS conditions:
      - request AccPedal (until t = 5s)
      - Low speed condtions
      - BrakePedal: != 0 at t = 5s
      - SOC < SOCMin
      - Fuel < fuelMin
      EXPECTED OUTPUT:
      - ICEdem == MGUdem == 0.
      - When Brake > 0 MGUdem < 0
      SOC and fuel are below the minimum and there is a request from AccPedal. The system must provide zero output in this particular condition, but must also be able to switch to Regenerative Braking when there comes BrakePedal request.
    model ControllerModel
    input "Scenario6.mat", mapped to AccPedal, BrakePedal, fuelLevel, SOC, realSpeed (active)
    assessment "Assessment1": At any point of time, whenever AccPedal > 0 is true then, with no delay, ICEdem == 0 & MGUdem == 0 & Brake == 0 must be true
    assessment "Assessment2": At any point of time, whenever BrakePedal > 0 is true then, with a delay of at most 0.25, Brake > 0 must be true
    assessment "Assessment3": At any point of time, whenever BrakePedal > 0 is true then, with a delay of at most 0.4, MGUdem < 0 & MGUdem < 1 must be true
      AccPedal: signal ControllerModel/AccPedal, port 1
      ICEdem: signal ControllerModel/Controller, port 1
      MGUdem: signal ControllerModel/Controller, port 3
      Brake: signal ControllerModel/Controller, port 2
      BrakePedal: signal ControllerModel/BrakePedal, port 1

  case "Test Case 7" [simulation]
    description: Scenario 7: Increasing speed
      INPUTS conditions:
      - request AccPedal
      - Speed uniformely increasing up to above the MaxSpeedMGU
      - BrakePedal: 0
      - SOC > SOCMin
      - Fuel > fuelMin
      EXPECTED OUTPUT:
      - ICEdem != 0
      - MGUdem != 0
      Vehicle is driving in a town environment at low speed, then gets in an extra­urban scenario, travelling at higher speed. Here the controller shall be able to switch from Electrical drive to Combined mode, demanding torque to both engines.
    model ControllerModel
    input "Scenario7.mat", mapped to AccPedal, BrakePedal, fuelLevel, SOC, realSpeed (active)
    assessment "Assessment1": At any point of time, whenever RealSpeed > 45 is true then, with a delay of at most 0.4, ICEdem > 0 must be true
    assessment "Assessment2": At any point of time, whenever AccPedal > 0 & RealSpeed > 45 is true then, with a delay of at most 0.2, MGUdem > 0 & ICEdem >  0 must be true
      RealSpeed: signal ControllerModel/realSpeed, port 1
      ICEdem: signal ControllerModel/Controller, port 1
      AccPedal: signal ControllerModel/AccPedal, port 1
      MGUdem: signal ControllerModel/Controller, port 3

  case "Test Case 8" [simulation]
    description: Scenario 8: Recharging
      INPUTS conditions:
      - AccPedal:
      - request up to t = 5s
      - request between t = 7s and t = 10s
      - Low Speed
      - BrakePedal: request between at t = 5s and t =7s
      - SOC < SOCMin until t = 7s
      - Fuel > fuelMin
      EXPECTED OUTPUT:
      - SOC increasing
      - When SOC > SOCmin, MGUdem != 0
      Vehicle starts with an almost empty battery, using only the IC engine. During the drive, the battery recharges through Regenerative Braking and when the State Of Charge is sufficient, the controller can require torque to the MGU.
    model ControllerModel
    input "Scenario8.mat", mapped to AccPedal, BrakePedal, fuelLevel, SOC, realSpeed (active)
    assessment "Assessment1": At any point of time, whenever SOC > 15 & AccPedal > 0 is true then, with a delay of at most 0.4, MGUdem > 0 must be true
      SOC: signal ControllerModel/SOC, port 1
      AccPedal: signal ControllerModel/AccPedal, port 1
      MGUdem: signal ControllerModel/Controller, port 3